# Dynamo graph AdjustAreaByType.dyn (Dynamo 2.3.0.5885)

categories = Categories("OST_Areas")
all_elements_of_category = ElementsOfCategory(Category=categories)
string = StringInput("Name")
string_2 = StringInput("Area")
getParameterValueByName = Element.GetParameterValueByName(element=all_elements_of_category, parameterName=string_2)
code_block = CodeBlock(ra=getParameterValueByName) { ra > 1200 ? "3 Br" : (ra < 700 && ra>400 ? "1 Br": (ra < 400 ? "Too Small" : "2 Br")); }
setParameterByName = Element.SetParameterByName(element=all_elements_of_category, parameterName=string, value=code_block)
watch = Watch(code_block)
