# Dynamo graph FindMaskingRegions.dyn (Dynamo 2.3.0.5885)
# packages: archi-lab.net 2020.22.7

boolean = BoolSelector(false)
family_types = FamilyTypes("QAQCsample:QAQCsample")
categories = Categories("OST_DetailComponents")
all_elements_of_category = ElementsOfCategory(Category=categories)
name = Element.Name(element=all_elements_of_category)
string = StringInput("Masking")
contains = String.Contains(str=name, searchFor=string)
filterByBoolMask = List.FilterByBoolMask(list=all_elements_of_category, mask=contains)
boundingBox = Element.BoundingBox(element=filterByBoolMask.in)
maxPoint = BoundingBox.MaxPoint(boundingBox=boundingBox)
byPoint = FamilyInstance.ByPoint(familyType=family_types, point=maxPoint)
string_2 = StringInput("Comments")
name_2 = Element.Name(element=filterByBoolMask.in)
setParameterByName = Element.SetParameterByName(element=byPoint, parameterName=string_2, value=name_2)
code_block = CodeBlock(del=boolean, e=setParameterByName) { del == true ? e : null; }
delete = archilab.Revit.Elements.Elements.Delete(element=code_block)
