# Dynamo graph PlaceFamilies.dyn (Dynamo 2.3.0.5885)

# group: Selection
select_face = DSFaceSelection()  # 1 picked in the model; graph input

# group: Action
integer_slider = IntegerSlider(16, range=0..20 step 1)  # graph input
randomList = Math.RandomList(amount=integer_slider)
randomList_2 = Math.RandomList(amount=integer_slider)
pointAtParameter = Surface.PointAtParameter(surface=select_face, u=randomList, v=randomList_2, lacing=Longest)

# group: Commit
family_types = FamilyTypes("RPC Male:Alex")  # graph input
byPoint = FamilyInstance.ByPoint(familyType=family_types, point=pointAtParameter)
