# Dynamo graph SendRoomInfoToExcel.dyn (Dynamo 2.3.0.5885)

# group: Selection
categories = Categories("OST_Rooms")
all_elements_of_category = ElementsOfCategory(Category=categories)

# group: Action
code_block = CodeBlock { "Name"; "Area"; }
getParameterValueByName = Element.GetParameterValueByName(element=all_elements_of_category, parameterName=code_block.out0)
getParameterValueByName_2 = Element.GetParameterValueByName(element=all_elements_of_category, parameterName=code_block.out1)

# group: Commit
file_path = Filename("G:\My Drive\Confrences\AU2019\Samples\dynamoExcel.xlsx")
code_block_2 = CodeBlock { "Sheet1"; }
code_block_3 = CodeBlock { 1; 0; }
exportExcel = Data.ExportExcel(filePath=file_path, sheetName=code_block_2, startRow=code_block_3.out0, startCol=code_block_3.out1, data=getParameterValueByName)
code_block_4 = CodeBlock { 1; 1; }
exportExcel_2 = Data.ExportExcel(filePath=file_path, sheetName=code_block_2, startRow=code_block_4.out0, startCol=code_block_4.out1, data=getParameterValueByName_2)
