# Dynamo graph TestFile.dyn (Dynamo 2.2.1.5175)

# group: PARAM SELECTIONS
parameterByName = Parameter.ParameterByName()  # unwired: element, name
get_family_parameter = FamilyInstanceParameters()  # nothing selected; unwired: f
findByName = GlobalParameter.FindByName()  # unwired: name

element_types = ElementTypes("Floor")
all_elements_of_type = ElementsOfType(element_type=element_types)

# group: ELEMENT SELECTIONS
select_model_element = DSModelElementSelection()  # 1 picked in the model
family_types = FamilyTypes("Window-Square Opening:36\" x 24\"")
all_elements_of_family_type = ElementsOfFamilyType(Family_Type=family_types)
categories = Categories("OST_Doors")
all_elements_of_category = ElementsOfCategory(Category=categories)
select_model_elements = DSModelElementsSelection()  # 2 picked in the model
element_types_2 = ElementTypes("Wall")
all_elements_of_type_2 = ElementsOfType(element_type=element_types_2)
wall_types = WallTypes("Generic - 6\"")
filterByType = WombatDynamo.Element.FilterByType(elements=all_elements_of_type_2, type=wall_types)
floor_types = FloorTypes("6\" Concrete")
filterByType_2 = WombatDynamo.Element.FilterByType(elements=all_elements_of_type, type=floor_types)
