# Dynamo graph adjust slabByOffset.dyn (Dynamo 2.3.0.5885)
# packages: spring nodes 203.1.0, WombatDynamo 1.3.2

select_model_element = DSModelElementSelection()  # 1 picked in the model
boolean = BoolSelector(true)
ꟿ_collect_elementsketch = Custom[ꟿ Collect.ElementSketch](element=select_model_element, fetchModelCurves=boolean)  # package spring nodes; Get the actual sketch lines of a sketch based element (floor, ceiling, modified wall, etc.) . You can optionally fetch the matching model curves, however this might prove comptationally heavy on larger data sets. Does not work with elements from linked files.
code_block = CodeBlock { 1; }
flatten = List.Flatten(list=ꟿ_collect_elementsketch.model_curves, amt=code_block)
flatten_2 = List.Flatten(list=ꟿ_collect_elementsketch.curves, amt=code_block)
code_block_2 = CodeBlock { 12; }
smartOffset = WombatDynamo.Curve.SmartOffset(curve=flatten_2, offsetDist=code_block_2)
ꟿ_element_setlocation = Custom[ꟿ Element.SetLocation](element=flatten, location=smartOffset)  # package spring nodes; Attempts to modify the location of the input element. This can effectively add as a move comand in Revit. Works for both line based and point based elements.
