# Dynamo graph renumberRooms.dyn (Dynamo 2.3.0.5885)

categories = Categories("OST_Rooms")
all_elements_of_category = ElementsOfCategory(Category=categories)
string = StringInput("Number")
string_2 = StringInput("Level")
getParameterValueByName = Element.GetParameterValueByName(element=all_elements_of_category, parameterName=string_2)
string_3 = StringInput(".")
add = getParameterValueByName + string_3
number = Room.Number(room=all_elements_of_category)
add_2 = add + number
setParameterByName = Element.SetParameterByName(element=all_elements_of_category, parameterName=string, value=add_2)
